# Grasshopper definition RozvanyDraw.gh (Grasshopper 1.0.7)
# plug-ins: Kangaroo2 Components, Karamba3D

pipeline = GeometryPipeline(
    GroupByLayer=False,
    GroupByType=False,
    IncludeHidden=True,
    IncludeLocked=True,
    LayerFilter="Clamped boundary",
    NameFilter="*",
    SublayerFiltering=False,
    TypeFilter=4)
pipeline_2 = GeometryPipeline(
    GroupByLayer=False,
    GroupByType=False,
    IncludeHidden=True,
    IncludeLocked=True,
    LayerFilter="Clamped interior",
    NameFilter="*",
    SublayerFiltering=False,
    TypeFilter=1)
pipeline_3 = GeometryPipeline(
    GroupByLayer=False,
    GroupByType=False,
    IncludeHidden=True,
    IncludeLocked=True,
    LayerFilter="Clamped interior",
    NameFilter="*",
    SublayerFiltering=False,
    TypeFilter=4)

boundarypoints = GetPoint(AtLeast=3, AtMost=2147483647, Realtime=True)
intline = GetPoint(AtLeast=0, AtMost=2147483647, Realtime=True)
item = ListItem(List=pipeline_3, Index=0, Wrap=True)  # -> Item, Item1, Item2
arcpoints = GetPoint(AtLeast=0, AtMost=3, Realtime=True)
end = EndPoints(Curve=item.Item2)  # -> Start, End
merge = Merge(Data1=end.Start, Data2=end.End)
disc = Discontinuity(Curve=item.Item, Level=1)  # -> Points, Parameters
item_2 = ListItem(List=arcpoints, Index=0, Wrap=True)  # -> Item, Item1, Item2
pline = PolyLine(Vertices=boundarypoints, Closed=invert(False))
pline_2 = PolyLine(Vertices=intline, Closed=False)  # -> simplify(Polyline)
explode = Explode(Curve=pipeline, Recursive=True)  # -> Segments, Vertices
intpoints = GetPoint(AtLeast=0, AtMost=2147483647, Realtime=True)
arc = Arc3Pt(PointA=item_2.Item, PointB=item_2.Item1, PointC=item_2.Item2)  # -> simplify(Arc), Plane, Radius

len = Length(Curve=arc.Arc)
number_slider = Slider(1, range=0..1)
division = Division(A=len, B=number_slider)
round = Round(Number=division)  # -> Nearest, Floor, Ceiling
divide = DivideCurve(Curve=simplify(graft(arc.Arc)), Count=simplify(graft(round.Nearest)), Kinks=False)  # -> Points, Tangents, Parameters
pline_3 = PolyLine(Vertices=divide.Points, Closed=False)
end_2 = EndPoints(Curve=graft(pline_3))  # -> Start, End
merge_2 = Merge(Data1=end_2.Start, Data2=end_2.End)
crv = Curve(pline_3)
pt = Point(merge_2)
pt_2 = Point(divide.Points)

explode_2 = Explode(Curve=pline, Recursive=True)  # -> Segments, Vertices
len_2 = Length(Curve=explode_2.Segments)
division_2 = Division(A=len_2, B=number_slider)
round_2 = Round(Number=division_2)  # -> Nearest, Floor, Ceiling
divide_2 = DivideCurve(Curve=explode_2.Segments, Count=round_2.Nearest, Kinks=False)  # -> Points, Tangents, Parameters
pline_4 = PolyLine(Vertices=divide_2.Points, Closed=False)
end_3 = EndPoints(Curve=graft(pline_4))  # -> Start, End
crv_2 = Curve(pline_4)
merge_3 = Merge(Data1=end_3.Start, Data2=end_3.End)
pt_3 = Point(divide_2.Points)
pt_4 = Point(merge_3)

len_3 = Length(Curve=pline_2)
division_3 = Division(A=len_3, B=number_slider)
round_3 = Round(Number=division_3)  # -> Nearest, Floor, Ceiling
divide_3 = DivideCurve(Curve=simplify(graft(pline_2)), Count=simplify(graft(round_3.Nearest)), Kinks=False)  # -> Points, Tangents, Parameters
pline_5 = PolyLine(Vertices=divide_3.Points, Closed=False)
end_4 = EndPoints(Curve=graft(pline_5))  # -> Start, End
merge_4 = Merge(Data1=end_4.Start, Data2=end_4.End)
crv_3 = Curve(pline_5)
pt_5 = Point(divide_3.Points)
pt_6 = Point(merge_4)
pt_7 = Point(intpoints)
merge_5 = Merge(Data1=pt_5, Data2=pt_2)

entwine = Entwine(Branch0X=simplify(merge_5), Branch1X=simplify(graft(pt_7)), Branch2X=simplify(pt_3), FlattenInputs=False)

pt_8 = Point(entwine)

voronoi = Voronoi(Points=flatten(pt_8), Boundary=pline, BruteForceOverride=False)

unflatten = UnflattenTree(Tree=voronoi, Guide=pt_8)
runion = RegionUnion(Curves=unflatten)

crv_4 = Curve(runion)
merge_6 = Merge(Data1=crv_4)
explode_3 = Explode(Curve=flatten(crv_4), Recursive=True)  # -> Segments, Vertices
dupln = RemoveDuplicateLines(Lines=flatten(explode_3.Segments), Tolerance=Slider(0.005, range=0..0.01))
join = JoinCurves(Curves=dupln, Preserve=False)
mcx = MultipleCurves(Curves=join)  # -> Points, IndexA, IndexB, ParamA, ParamB
Z = UnitZ(Factor=1)
line = LineSDL(Start=mcx.Points, Direction=Z, Length=1)
ccx = CurveCurve(CurveA=graft(crv_4), CurveB=line)  # -> Points, ParamsA, ParamsB
pshift = ShiftPaths(Data=simplify(ccx.ParamsA), Offset=-1)
shatter = Shatter(Curve=graft(crv_4), Parameters=pshift)
eval = EvaluateLength(Curve=flatten(shatter), Length=Slider(0.5, range=0..1), Normalized=True)  # -> Point, Tangent, Parameter
rdpoints = RemoveDuplicatePointsKaramba(Point=eval.Point, LimitDistance=Slider(0.05, range=0..1))  # -> OutPoint, Info, Indexes
cull_i = CullIndex(List=flatten(shatter), Indices=rdpoints.Indexes, Wrap=False)
eval_2 = EvaluateLength(Curve=flatten(cull_i), Length=Slider(0.5, range=0..1), Normalized=True)  # -> Point, Tangent, Parameter
points = PointList(Points=flatten(eval_2.Point))

merge_7 = Merge(Data1=cull_i, Data2=pline_3)  # -> flatten(Result)

len_4 = Length(Curve=merge_7)
division_4 = Division(A=len_4, B=number_slider)
round_4 = Round(Number=division_4)  # -> Nearest, Floor, Ceiling
divide_4 = DivideCurve(Curve=merge_7, Count=round_4.Nearest, Kinks=False)  # -> Points, Tangents, Parameters

merge_8 = Merge(Data1=divide_4.Points, Data2=pt_7)
cullpt = CullDuplicates(Points=flatten(merge_8), Tolerance=0.1, CullMode=3)  # -> Points, Indices, Valence
voronoi_2 = Voronoi(Points=flatten(cullpt.Points), Boundary=pline, BruteForceOverride=False)

# ---- group: RH_OUT:curves
crv_5 = Curve(voronoi_2)
